test file "DriverSwRequestTestManager"
  coverage: Decision, MCDC, Condition

suite "Unit test for DriverSwRequest"

  case "Enable button" [simulation]
    model DriverSwRequest, harness DriverSwRequest_Harness1
    signal scenario: Enable (DriverSwRequest_Harness1/Harness Inputs)
    custom criteria:
      yout = sltest_simout.get('yout');

      % Accessing the output values of the 1st Outport
      reqModeVerification = yout{1}.Values.Data;

      % Verfiying that reqModeVerification contains all 1's
      test.verifyTrue(all(reqModeVerification))

  case "Cancel button" [simulation]
    model DriverSwRequest, harness DriverSwRequest_Harness1
    signal scenario: Cancel (DriverSwRequest_Harness1/Harness Inputs)
    custom criteria: same code as in custom criteria of case "Enable button"

  case "Set button" [simulation]
    model DriverSwRequest, harness DriverSwRequest_Harness1
    signal scenario: Set (DriverSwRequest_Harness1/Harness Inputs)
    custom criteria: same code as in custom criteria of case "Enable button"

  case "Set button_fail" [simulation]
    model DriverSwRequest, harness DriverSwRequest_Harness1
    signal scenario: Set_fail (DriverSwRequest_Harness1/Harness Inputs)
    custom criteria: same code as in custom criteria of case "Enable button"

  case "Resume button" [simulation]
    model DriverSwRequest, harness DriverSwRequest_Harness1
    signal scenario: Resume (DriverSwRequest_Harness1/Harness Inputs)
    custom criteria: same code as in custom criteria of case "Enable button"

suite "Unit test for Throttle duration"

  case "Increment button short" [simulation]
    model DriverSwRequest, harness DriverSwRequest_Harness1
    signal scenario: ShortInc (DriverSwRequest_Harness1/Harness Inputs)
    custom criteria: same code as in custom criteria of case "Enable button"

  case "Increment button hold" [simulation]
    model DriverSwRequest, harness DriverSwRequest_Harness1
    signal scenario: LongInc (DriverSwRequest_Harness1/Harness Inputs)
    custom criteria: same code as in custom criteria of case "Enable button"

  case "Decrement button short" [simulation]
    model DriverSwRequest, harness DriverSwRequest_Harness1
    signal scenario: ShortDec (DriverSwRequest_Harness1/Harness Inputs)
    custom criteria: same code as in custom criteria of case "Enable button"

  case "Decrement button hold" [simulation]
    model DriverSwRequest, harness DriverSwRequest_Harness1
    signal scenario: LongDec (DriverSwRequest_Harness1/Harness Inputs)
    custom criteria: same code as in custom criteria of case "Enable button"